# Grasshopper definition CALCULUS_Antiderivatives_Indefinite_Integrals_018.gh (Grasshopper 1.0.8)
# plug-ins: RhinoCodePluginGH

# Visualizing Calculus Algorithm
# from
# gpt Image Prompt
number_slider = Slider(-10, range=-10..10)
antiderivatives_indefinite_integrals_018 = Script(
    a=Slider(0.58, range=-10..10),
    b=Slider(-2.37, range=-10..10),
    c=Slider(4.16, range=-10..10),
    xStart=Slider(-10, range=-10..10),
    xEnd=Slider(5.46, range=-1..10),
    xResolution=Slider(200, range=0..200),
    cStart=Slider(-2.73, range=-10..10),
    cEnd=Slider(3.51, range=-10..10),
    cResolution=Slider(200, range=0..200))  # -> out, FunctionSurface, AntiderivativeSurface; "Antiderivatives_Indefinite_Integrals_018b"; inputs a: Double, b: Double, c: Double, xStart: Double, xEnd: Double, xResolution: Int32, cStart: Double, cEnd: Double, cResolution: Int32
# ---------- antiderivatives_indefinite_integrals_018: C# ----------
using System;
using System.Collections.Generic;
using System.Drawing;

using Rhino;
using Rhino.Geometry;

using Grasshopper;
using Grasshopper.Kernel;
using Grasshopper.Kernel.Types;

public class Script_Instance : GH_ScriptInstance
{
  private void RunScript(
	double a,
	double b,
	double c,
	double xStart,
	double xEnd,
	int xResolution,
	double cStart,
	double cEnd,
	int cResolution,
	ref object FunctionSurface,
	ref object AntiderivativeSurface)
  {
    // Validate input parameters
    if (xResolution <= 0 || cResolution <= 0)
    {
      FunctionSurface = null;
      AntiderivativeSurface = null;
      Print("Resolutions must be greater than zero.");
      return;
    }

    // Prepare lists to store points for surfaces
    var functionPoints = new List<Point3d>();
    var antiderivativePoints = new List<Point3d>();

    double dx = (xEnd - xStart) / xResolution;
    double dC = (cEnd - cStart) / cResolution;

    for (int i = 0; i <= xResolution; i++)
    {
      double x = xStart + i * dx;

      for (int j = 0; j <= cResolution; j++)
      {
        double C = cStart + j * dC;

        // Calculate the function and antiderivative values
        double fx = a * x * x + b * Math.Sin(c * x);
        double Fx = (a / 3.0) * x * x * x - (b / c) * Math.Cos(c * x) + C;

        // Collect points for plotting
        functionPoints.Add(new Point3d(x, C, fx)); // Function point at (x, C, f(x))
        antiderivativePoints.Add(new Point3d(x, C, Fx)); // Antiderivative point at (x, C, F(x))
      }
    }

    // Create surfaces from points
    FunctionSurface = CreateSurface(functionPoints, xResolution + 1, cResolution + 1);
    AntiderivativeSurface = CreateSurface(antiderivativePoints, xResolution + 1, cResolution + 1);
  }

  private NurbsSurface CreateSurface(List<Point3d> points, int width, int height)
  {
    var srf = NurbsSurface.CreateFromPoints(points, width, height, 3, 3);
    return srf;
  }

  // <Custom additional code> 

  public override void BeforeRunScript()
  {
    // Optional: Code to execute before the main script runs
  }

  // <Custom additional code end>
}
# ---------- end antiderivatives_indefinite_integrals_018 ----------
# Created at
# Wickerson Studios
# copyright 2024
# download all materials at
# www.wickersonstudios.com
_008_antiderivatives_indefinite_integral = Script(start=number_slider, end=Slider(10, range=-1..10), resolution=Slider(126, range=0..200))  # -> out, FunctionCurve, AntiderivativeCurve; "008_Antiderivatives_Indefinite_Integrals_018"; inputs start: Double, end: Double, resolution: Int32
# ---------- _008_antiderivatives_indefinite_integral: C# ----------
using System;
using System.Collections.Generic;
using System.Drawing;

using Rhino;
using Rhino.Geometry;

using Grasshopper;
using Grasshopper.Kernel;
using Grasshopper.Kernel.Types;

public class Script_Instance : GH_ScriptInstance
{
  private void RunScript(
	double start,
	double end,
	int resolution,
	ref object FunctionCurve,
	ref object AntiderivativeCurve)
  {
    // Validate input parameters
    if (resolution <= 0)
    {
      FunctionCurve = null;
      AntiderivativeCurve = null;
      Print("Resolution must be greater than zero.");
      return;
    }

    // Lists to store the points for function and antiderivative curves
    List<Point3d> functionPoints = new List<Point3d>();
    List<Point3d> antiderivativePoints = new List<Point3d>();

    // Calculation step
    double dx = (end - start) / resolution;
    double constant = 0; // Initial condition for the antiderivative

    // Calculate points for the function and its antiderivative
    for (int i = 0; i <= resolution; i++)
    {
      double x = start + i * dx;
      double fx = x * x; // f(x) = x^2
      double Fx = (1.0 / 3.0) * x * x * x + constant; // F(x) = 1/3 * x^3 + C

      // Collect points for plotting
      functionPoints.Add(new Point3d(x, fx, 0)); // Function point at (x, f(x), 0)
      antiderivativePoints.Add(new Point3d(x, Fx, 0)); // Antiderivative point at (x, F(x), 0)
    }

    // Create curves from points
    FunctionCurve = new Polyline(functionPoints).ToNurbsCurve();
    AntiderivativeCurve = new Polyline(antiderivativePoints).ToNurbsCurve();
  }

  // <Custom additional code> 

  public override void BeforeRunScript()
  {
    // Optional: Code to execute before the main script runs
  }

  // <Custom additional code end>
}
# ---------- end _008_antiderivatives_indefinite_integral ----------
curve = Curve(_008_antiderivatives_indefinite_integral.AntiderivativeCurve)
curve_2 = Curve(_008_antiderivatives_indefinite_integral.FunctionCurve)
geometry = Geometry(antiderivatives_indefinite_integrals_018.FunctionSurface)
geometry_2 = Geometry(antiderivatives_indefinite_integrals_018.AntiderivativeSurface)
panel = Panel(antiderivatives_indefinite_integrals_018.out)
panel_2 = Panel(_008_antiderivatives_indefinite_integral.out)
param_viewer = ParamViewer(geometry)
param_viewer_2 = ParamViewer(curve_2)
panel_3 = Panel([curve_2, curve])
panel_4 = Panel([geometry, geometry_2])
