# Grasshopper definition CALCULUS_Cosine_Sine_Special_Angles_019.gh (Grasshopper 1.0.8)
# plug-ins: RhinoCodePluginGH

trigger = Trigger(Interval=20, TimerInterval=20, Target=data_recorder)
data_recorder = DataRecorder("1", DataLimit=1000, RecordData=True)
list_length = ListLength(List=data_recorder)
division = Division(A=list_length, B=Slider(210, range=0..1000))
sine = Sine(Value=division)
cosine = Cosine(Value=division)
number_slider = Slider(14.74, range=-20..20)
multiplication = Multiplication(B=sine)
multiplication_2 = Multiplication(A=Slider(14.74, range=-20..20), B=cosine)
cosine_sine_special_angles_019 = Script(
    width=Slider(100, range=0..100),
    height=Slider(100, range=0..100),
    uDivisions=Slider(10, range=0..10),
    vDivisions=Slider(10, range=0..10),
    freq=multiplication,
    amp=multiplication_2)  # -> out, A, B, C; inputs width: Double, height: Double, uDivisions: Int32, vDivisions: Int32, freq: Double, amp: Double
# ---------- cosine_sine_special_angles_019: C# ----------
// Grasshopper Script Instance
#region Usings
using System;
using System.Linq;
using System.Collections;
using System.Collections.Generic;
using System.Drawing;

using Rhino;
using Rhino.Geometry;

using Grasshopper;
using Grasshopper.Kernel;
using Grasshopper.Kernel.Data;
using Grasshopper.Kernel.Types;
#endregion

public class Script_Instance : GH_ScriptInstance
{
    #region Notes
    /* 
      Members:
        RhinoDoc RhinoDocument
        GH_Document GrasshopperDocument
        IGH_Component Component
        int Iteration

      Methods (Virtual & overridable):
        Print(string text)
        Print(string format, params object[] args)
        Reflect(object obj)
        Reflect(object obj, string method_name)
    */
    #endregion

    private void RunScript(
	double width,
	double height,
	int uDivisions,
	int vDivisions,
	double freq,
	double amp,
	ref object A,
	ref object B,
	ref object C)
    {
        List<Surface> surfaces = new List<Surface>();

        // Special angles for cosine and sine
        double[] angles = new double[] { freq * Math.PI / 4, freq * Math.PI / 3, freq * Math.PI / 6 };

        foreach (double angle in angles)
        {
            List<Point3d> points = new List<Point3d>();

            for (int i = 0; i <= uDivisions; i++)
            {
                for (int j = 0; j <= vDivisions; j++)
                {
                    double u = width * i / uDivisions;
                    double v = height * j / vDivisions;
                    double z = amp * Math.Cos(u * angle) * Math.Sin(v * angle);
                    points.Add(new Point3d(u, v, z));
                }
            }

            // Create a surface from points
            NurbsSurface surface = NurbsSurface.CreateFromPoints(points, uDivisions + 1, vDivisions + 1, 3, 3);
            surfaces.Add(surface);
        }

        // Output the surfaces separately
        A = surfaces[0];
        B = surfaces[1];
        C = surfaces[2];
    }
}
# ---------- end cosine_sine_special_angles_019 ----------
# Created at
# Wickerson Studios
# copyright 2024
# download all materials at
# www.wickersonstudios.com
# Visualizing Calculus Algorithm
# from
# gpt Image Prompt
cosine_sine_special_angles_019_2 = Script()  # -> out, A, B, C
# ---------- cosine_sine_special_angles_019_2: C# ----------
// Grasshopper Script Instance
#region Usings
using System;
using System.Linq;
using System.Collections;
using System.Collections.Generic;
using System.Drawing;

using Rhino;
using Rhino.Geometry;

using Grasshopper;
using Grasshopper.Kernel;
using Grasshopper.Kernel.Data;
using Grasshopper.Kernel.Types;
#endregion

public class Script_Instance : GH_ScriptInstance
{
    #region Notes
    /* 
      Members:
        RhinoDoc RhinoDocument
        GH_Document GrasshopperDocument
        IGH_Component Component
        int Iteration

      Methods (Virtual & overridable):
        Print(string text)
        Print(string format, params object[] args)
        Reflect(object obj)
        Reflect(object obj, string method_name)
    */
    #endregion

    private void RunScript(
	object x,
	object y,
	ref object A,
	ref object B,
	ref object C)
    {
        // Inputs
        double width = 10; // Width of the surface grid
        double height = 10; // Height of the surface grid
        int uDivisions = 100; // Number of divisions along u-axis
        int vDivisions = 100; // Number of divisions along v-axis

        List<Surface> surfaces = new List<Surface>();

        // Special angles for cosine and sine
        double[] angles = new double[] { Math.PI / 4, Math.PI / 3, Math.PI / 6 };

        foreach (double angle in angles)
        {
            List<Point3d> points = new List<Point3d>();

            for (int i = 0; i <= uDivisions; i++)
            {
                for (int j = 0; j <= vDivisions; j++)
                {
                    double u = width * i / uDivisions;
                    double v = height * j / vDivisions;
                    double z = Math.Cos(u * angle) * Math.Sin(v * angle);
                    points.Add(new Point3d(u, v, z));
                }
            }

            // Create a surface from points
            NurbsSurface surface = NurbsSurface.CreateFromPoints(points, uDivisions + 1, vDivisions + 1, 3, 3);
            surfaces.Add(surface);
        }

        // Output the surfaces separately
        A = surfaces[0];
        B = surfaces[1];
        C = surfaces[2];
    }
}
# ---------- end cosine_sine_special_angles_019_2 ----------
geometry = Geometry(cosine_sine_special_angles_019_2.A)
geometry_2 = Geometry(cosine_sine_special_angles_019_2.B)
geometry_3 = Geometry(cosine_sine_special_angles_019_2.C)
geometry_4 = Geometry(cosine_sine_special_angles_019.A)
geometry_5 = Geometry(cosine_sine_special_angles_019.B)
geometry_6 = Geometry(cosine_sine_special_angles_019.C)
panel = Panel([geometry, geometry_2, geometry_3])
panel_2 = Panel([geometry_4, geometry_5, geometry_6])
panel_3 = Panel(cosine_sine_special_angles_019_2.out)
panel_4 = Panel(cosine_sine_special_angles_019.out)
param_viewer = ParamViewer(geometry)
param_viewer_2 = ParamViewer(geometry_4)
