# Grasshopper definition CALCULUS_Differentials_ Sums and Constant Multiples_014.gh (Grasshopper 1.0.8)
# plug-ins: RhinoCodePluginGH

# Created at
# Wickerson Studios
# copyright 2024
# download all materials at
# www.wickersonstudios.com
# Visualizing Calculus Algorithm
# from
# gpt Image Prompt
number_slider = Slider(-0.1, range=-3..3)
differentiation_sumsconstantmultiples = Script(A=number_slider, B=Slider(0.72, range=-3..3), C=Slider(-0.1, range=-3..3), D=Slider(-0.79, range=-3..3))  # -> out, Result; inputs A: Double, B: Double, C: Double, D: Double
# ---------- differentiation_sumsconstantmultiples: C# ----------
using System;
using System.Collections;
using System.Collections.Generic;
using System.Drawing;

using Rhino;
using Rhino.Geometry;

using Grasshopper;
using Grasshopper.Kernel;
using Grasshopper.Kernel.Data;
using Grasshopper.Kernel.Types;

public class Script_Instance : GH_ScriptInstance
{
  private void RunScript(
	double A,
	double B,
	double C,
	double D,
	ref object Result)
  {
    // Constants and variables for the surface dimensions
    int uCount = 100; // Number of points in the u-direction
    int vCount = 100; // Number of points in the v-direction
    double range = 10.0; // Range for x and y values

    // Prepare a mesh to output the geometry
    Mesh calculusSurface = new Mesh();

    // Generating points and calculating derivatives based on the input functions
    for (int i = 0; i < uCount; i++)
    {
      for (int j = 0; j < vCount; j++)
      {
        // Scale i, j to be within the specified range
        double x = range * (i / (uCount - 1.0)) - range / 2.0;
        double y = range * (j / (vCount - 1.0)) - range / 2.0;

        // Function definition: f(x, y) = A*x + B*y + C*x^2 + D*y^2
        double fx = A * x + C * 2 * x; // Partial derivative with respect to x
        double fy = B * y + D * 2 * y; // Partial derivative with respect to y

        // Create a vertex at (x, y, z) where z is a function of fx and fy
        Point3d vertex = new Point3d(x, y, fx + fy);
        calculusSurface.Vertices.Add(vertex);
      }
    }

    // Convert mesh vertices to faces for a grid mesh
    for (int i = 0; i < uCount - 1; i++)
    {
      for (int j = 0; j < vCount - 1; j++)
      {
        int lowerLeft = i * vCount + j;
        int lowerRight = lowerLeft + 1;
        int upperLeft = lowerLeft + vCount;
        int upperRight = upperLeft + 1;
        
        calculusSurface.Faces.AddFace(lowerLeft, lowerRight, upperRight, upperLeft);
      }
    }

    // Set the output object Result to the created mesh
    Result = calculusSurface;
  }
}
# ---------- end differentiation_sumsconstantmultiples ----------
mesh = Mesh(differentiation_sumsconstantmultiples.Result)
panel = Panel(differentiation_sumsconstantmultiples.out)
panel_2 = Panel(mesh)
param_viewer = ParamViewer(mesh)
