# Grasshopper definition CALCULUS_Differentials_ TheProductRule_014b.gh (Grasshopper 1.0.8)
# plug-ins: RhinoCodePluginGH

# Created at
# Wickerson Studios
# copyright 2024
# download all materials at
# www.wickersonstudios.com
# Visualizing Calculus Algorithm
# from
# gpt Image Prompt
number_slider = Slider(2.31, range=-3..3)
differentiation_theproductrule_014b = Script(freqX=number_slider, freqY=Slider(0.26, range=-3..3), ampX=Slider(0.28, range=0..1), ampY=Slider(0.62, range=0..1))  # -> out, A; inputs freqX: Double, freqY: Double, ampX: Double, ampY: Double
# ---------- differentiation_theproductrule_014b: C# ----------
using System;
using System.Collections;
using System.Collections.Generic;
using System.Drawing;

using Rhino;
using Rhino.Geometry;

using Grasshopper;
using Grasshopper.Kernel;
using Grasshopper.Kernel.Data;
using Grasshopper.Kernel.Types;

public class Script_Instance : GH_ScriptInstance
{
  private void RunScript(
	double freqX,
	double freqY,
	double ampX,
	double ampY,
	ref object A)
  {
    // Constants for the surface dimensions
    int uCount = 100; // Number of points in the u-direction
    int vCount = 100; // Number of points in the v-direction
    double range = 10.0; // Range for x and y values

    // Prepare a mesh to output the geometry
    Mesh calculusSurface = new Mesh();

    // Generating points and calculating derivatives using the product rule
    for (int i = 0; i < uCount; i++)
    {
      for (int j = 0; j < vCount; j++)
      {
        // Scale i, j to be within the specified range
        double x = range * (i / (uCount - 1.0)) - range / 2.0;
        double y = range * (j / (vCount - 1.0)) - range / 2.0;

        // Function definitions
        double f = Math.Sin(freqX * x) * Math.Cos(freqY * y);
        double g = Math.Cos(freqX * x) * Math.Sin(freqY * y);
        
        // Derivatives of the functions
        double df_dx = freqX * Math.Cos(freqX * x) * Math.Cos(freqY * y);
        double dg_dx = -freqX * Math.Sin(ampX * x) * Math.Sin(ampY * y);
        double df_dy = -freqY * Math.Sin(freqX * x) * Math.Sin(freqY * y);
        double dg_dy = freqY * Math.Cos(ampX * x) * Math.Cos(ampY * y);

        // Applying the product rule: (f'g + fg')
        double zX = df_dx * g + f * dg_dx;
        double zY = df_dy * g + f * dg_dy;

        // Create a vertex at (x, y, z) where z is a sum of derivatives in x and y directions
        Point3d vertex = new Point3d(x, y, zX + zY);
        calculusSurface.Vertices.Add(vertex);
      }
    }

    // Convert mesh vertices to faces for a grid mesh
    for (int i = 0; i < uCount - 1; i++)
    {
      for (int j = 0; j < vCount - 1; j++)
      {
        int lowerLeft = i * vCount + j;
        int lowerRight = lowerLeft + 1;
        int upperLeft = lowerLeft + vCount;
        int upperRight = upperLeft + 1;
        
        calculusSurface.Faces.AddFace(lowerLeft, lowerRight, upperRight, upperLeft);
      }
    }

    // Set the output object A to the created mesh
    A = calculusSurface;
  }

  // <Custom additional code> 

  public override void BeforeRunScript()
  {
    // Optional: Code to execute before the main script runs
  }

  // <Custom additional code end>
}
# ---------- end differentiation_theproductrule_014b ----------
geometry = Geometry(differentiation_theproductrule_014b.A)
panel = Panel(geometry)
param_viewer = ParamViewer(geometry)
