# Grasshopper definition CALCULUS_Differentials_013.gh (Grasshopper 1.0.8)
# plug-ins: RhinoCodePluginGH

# Created at
# Wickerson Studios
# copyright 2024
# download all materials at
# www.wickersonstudios.com
# Visualizing Calculus Algorithm
# from
# gpt Image Prompt
number_slider = Slider(38, range=0..100)
number_slider_2 = Slider(10, range=-10..10)
number_slider_3 = Slider(-10, range=-10..10)
leibniznotation_012b = Script(
    x=number_slider,
    y=Slider(38, range=0..100),
    amplitude=Slider(-2.62, range=-3..3),
    frequency=Slider(0.31, range=-3..3),
    uStart=number_slider_3,
    uEnd=number_slider_2,
    vStart=number_slider_3,
    vEnd=number_slider_2)  # -> out, A; inputs amplitude: Double, frequency: Double, uStart: Double, uEnd: Double, vStart: Double, vEnd: Double
# ---------- leibniznotation_012b: C# ----------
#region Usings
using System;
using System.Collections.Generic;
using System.Drawing;

using Rhino;
using Rhino.Geometry;

using Grasshopper;
using Grasshopper.Kernel;
using Grasshopper.Kernel.Data;
using Grasshopper.Kernel.Types;
#endregion

public class Script_Instance : GH_ScriptInstance
{
    #region Notes
    /* 
      Members:
        RhinoDoc RhinoDocument
        GH_Document GrasshopperDocument
        IGH_Component Component
        int Iteration

      Methods (Virtual & overridable):
        Print(string text)
        Print(string format, params object[] args)
        Reflect(object obj)
        Reflect(object obj, string method name)
    */
    #endregion

    private void RunScript(
	object x,
	object y,
	double amplitude,
	double frequency,
	double uStart,
	double uEnd,
	double vStart,
	double vEnd,
	ref object A)
    {
        // Validate inputs and ensure they are positive integers
        if (!int.TryParse(x.ToString(), out int uCount) || uCount < 2)
            uCount = 50; // Default to 50 if input is invalid or too small
        if (!int.TryParse(y.ToString(), out int vCount) || vCount < 2)
            vCount = 50; // Default to 50 if input is invalid or too small

        double uMin = uStart, uMax = uEnd;
        double vMin = vStart, vMax = vEnd;
        Mesh mesh = new Mesh();

        for (int i = 0; i <= uCount; i++)
        {
            for (int j = 0; j <= vCount; j++)
            {
                double u = uMin + i * (uMax - uMin) / uCount;
                double v = vMin + j * (vMax - vMin) / vCount;

                double xCoord = u;
                double yCoord = v;
                double zCoord = amplitude * Math.Sin(frequency * (u + v)); // Z coordinate based on the sine of (u + v)

                Point3d point = new Point3d(xCoord, yCoord, zCoord);
                mesh.Vertices.Add(point);

                // Add faces in a grid fashion
                if (i > 0 && j > 0)
                {
                    int lastRowStart = (i - 1) * (vCount + 1);
                    int currentRowStart = i * (vCount + 1);

                    int a = lastRowStart + j - 1;
                    int b = currentRowStart + j - 1;
                    int c = currentRowStart + j;
                    int d = lastRowStart + j;

                    mesh.Faces.AddFace(a, b, c, d);
                }
            }
        }

        A = mesh; // Output the mesh
    }
}
# ---------- end leibniznotation_012b ----------
panel = Panel(leibniznotation_012b.out)
geometry = Geometry(leibniznotation_012b.A)
panel_2 = Panel(geometry)
param_viewer = ParamViewer(geometry)
