# Grasshopper definition CALCULUS_Differentials_The_Chain_Rule_014d.gh (Grasshopper 1.0.8)
# plug-ins: RhinoCodePluginGH

# Visualizing Calculus Algorithm
# from
# gpt Image Prompt
number_slider = Slider(2.96, range=-1..10)
# Created at
# Wickerson Studios
# copyright 2024
# download all materials at
# www.wickersonstudios.com
differentiation_the_chain_rule_014d = Script(range=number_slider, resolution=Slider(10, range=0..10))  # -> out, A; inputs range: Double, resolution: Int32
# ---------- differentiation_the_chain_rule_014d: C# ----------
using System;
using System.Collections;
using System.Collections.Generic;
using System.Drawing;

using Rhino;
using Rhino.Geometry;

using Grasshopper;
using Grasshopper.Kernel;
using Grasshopper.Kernel.Data;
using Grasshopper.Kernel.Types;

public class Script_Instance : GH_ScriptInstance
{
  private void RunScript(double range, int resolution, ref object A)
  {
    // Variables for the surface dimensions
    double r = range; // Range for x and y values
    int res = resolution; // Resolution of the grid

    // Prepare a list to hold the geometry separately
    List<Point3d> points = new List<Point3d>();

    // Generating points and calculating derivatives using the reciprocal rule
    for (int i = 0; i <= res; i++)
    {
      for (int j = 0; j <= res; j++)
      {
        // Scale i, j to be within the specified range [-r, r]
        double x = 2 * r * (i / (double) res) - r;
        double y = 2 * r * (j / (double) res) - r;

        // Define the function g(x, y) = x^2 + y^2
        double g = x * x + y * y;
        if (g == 0) continue; // Avoid division by zero

        // Calculate the derivatives of g with respect to x and y
        double gx = 2 * x;
        double gy = 2 * y;

        // Apply the reciprocal rule
        double fx = -gx / (g * g);
        double fy = -gy / (g * g);

        // Create a point where the z coordinate is the sum of the derivatives
        Point3d point = new Point3d(x, y, fx + fy);
        points.Add(point);
      }
    }

    // Set the output object A to the list of points
    A = points;
  }

  // <Custom additional code> 

  public override void BeforeRunScript()
  {
    // Optional: Code to execute before the main script runs
  }

  // <Custom additional code end>
}
# ---------- end differentiation_the_chain_rule_014d ----------
geometry = Geometry(differentiation_the_chain_rule_014d.A)
panel = Panel(geometry)
param_viewer = ParamViewer(geometry)
