# Grasshopper definition CALCULUS_Implicit_Differentiation_015.gh (Grasshopper 1.0.8)
# plug-ins: RhinoCodePluginGH

# Created at
# Wickerson Studios
# copyright 2024
# download all materials at
# www.wickersonstudios.com
# Visualizing Calculus Algorithm
# from
# gpt Image Prompt
number_slider = Slider(2.5, range=-1..10)
number_slider_2 = Slider(1.99, range=-1..10)
differentiation_the_chain_rule_014d = Script(range=number_slider, resolution=Slider(5, range=0..10), freq=number_slider_2, amp=number_slider_2)  # -> out, A; inputs range: Double, resolution: Int32, freq: Double, amp: Double
# ---------- differentiation_the_chain_rule_014d: C# ----------
using System;
using System.Collections.Generic;
using System.Drawing;

using Rhino.Geometry;

using Grasshopper.Kernel;
using Grasshopper.Kernel.Types;

public class Script_Instance : GH_ScriptInstance
{
  private void RunScript(
	double range,
	int resolution,
	double freq,
	double amp,
	ref object A)
  {
    // Constants for the surface dimensions
    double r = range; // Range for x and y values
    int res = resolution; // Resolution of the grid

    // Initialize the list of points for the NURBS surface
    List<Point3d> points = new List<Point3d>();

    // Generating points and calculating derivatives using the Chain Rule
    for (int i = 0; i <= res; i++)
    {
      for (int j = 0; j <= res; j++)
      {
        // Scale i, j to be within the specified range [-r, r]
        double x = 2 * r * (i / (double)res) - r;
        double y = 2 * r * (j / (double)res) - r;

        // Define the inner function g(x, y)
        double g = Math.Sin(freq * (x * x + y * y));

        // Derivative of g with respect to x and y
        double gx = 2 * freq * x * Math.Cos(freq * (x * x + y * y));
        double gy = 2 * freq * y * Math.Cos(freq * (x * x + y * y));

        // The outer function f(g) and its derivative
        double f = Math.Exp(amp * g);
        double derivativeMagnitude = Math.Sqrt(f * gx * f * gx + f * gy * f * gy);

        // Store the computed value as the z-coordinate at each grid point
        points.Add(new Point3d(x, y, derivativeMagnitude));
      }
    }

    // Create the NURBS surface from the list of points
    if (points.Count > 0)
    {
      int cols = res + 1; // Number of points in each direction
      A = NurbsSurface.CreateFromPoints(points, cols, cols, 3, 3);
    }
    else
    {
      A = null;
    }
  }

  // <Custom additional code> 

  public override void BeforeRunScript()
  {
    // Optional: Code to execute before the main script runs
  }

  // <Custom additional code end>
}
# ---------- end differentiation_the_chain_rule_014d ----------
panel = Panel(differentiation_the_chain_rule_014d.out)
geometry = Geometry(differentiation_the_chain_rule_014d.A)
panel_2 = Panel(geometry)
param_viewer = ParamViewer(geometry)
