# Grasshopper definition CALCULUS_Leibniz_Notation_012.gh (Grasshopper 1.0.8)
# plug-ins: RhinoCodePluginGH

# Created at
# Wickerson Studios
# copyright 2024
# download all materials at
# www.wickersonstudios.com
# Visualizing Calculus Algorithm
# from
# gpt Image Prompt
sphere = Sphere(Base=PlaneXY(0, 0, 0), Radius=1)
tangentslopenormals_011 = Script(surface=sphere, uDivisions=Slider(8, range=0..10), vDivisions=Slider(6, range=0..10))  # -> out, TangentLines, NormalLines; inputs surface: Surface, uDivisions: Int32, vDivisions: Int32
# ---------- tangentslopenormals_011: C# ----------
// Grasshopper Script Instance
#region Usings
using System;
using System.Linq;
using System.Collections;
using System.Collections.Generic;
using System.Drawing;

using Rhino;
using Rhino.Geometry;

using Grasshopper;
using Grasshopper.Kernel;
using Grasshopper.Kernel.Data;
using Grasshopper.Kernel.Types;
#endregion

// Grasshopper Script Instance
#region Usings
using System;
using System.Collections.Generic;
using Rhino.Geometry;
#endregion

public class Script_Instance : GH_ScriptInstance
{
    #region Notes
    /* 
      Members:
        RhinoDoc RhinoDocument
        GH_Document GrasshopperDocument
        IGH_Component Component
        int Iteration

      Methods (Virtual & overridable):
        Print(string text)
        Print(string format, params object[] args)
        Reflect(object obj)
        Reflect(object obj, string method_name)
    */
    #endregion

    private void RunScript(
	Surface surface,
	int uDivisions,
	int vDivisions,
	ref object TangentLines,
	ref object NormalLines)
    {
        if (surface == null)
        {
            Print("Please provide a valid surface.");
            return;
        }

        // Initialize lists to hold tangent and normal lines
        List<Line> tangents = new List<Line>();
        List<Line> normals = new List<Line>();

        // Divide the surface and evaluate tangents and normals
        for (int i = 0; i <= uDivisions; i++)
        {
            for (int j = 0; j <= vDivisions; j++)
            {
                double u = i / (double)uDivisions;
                double v = j / (double)vDivisions;

                // Out parameters for surface evaluation
                Point3d point;
                Vector3d[] derivatives = new Vector3d[3];

                // Evaluate the surface at (u, v)
                surface.Evaluate(u, v, 2, out point, out derivatives);

                // Extract tangent vectors and compute normal
                Vector3d tangentU = derivatives[1];
                Vector3d tangentV = derivatives[2];
                Vector3d normal = Vector3d.CrossProduct(tangentU, tangentV);

                // Normalize the normal vector
                if (!normal.Unitize())
                {
                    Print("Failed to normalize the normal vector at (" + u + ", " + v + ")");
                }

                // Create lines from the computed vectors
                tangents.Add(new Line(point, point + tangentU));
                tangents.Add(new Line(point, point + tangentV));
                normals.Add(new Line(point, point + normal));
            }
        }

        // Assign the computed lines to the output parameters
        TangentLines = tangents;
        NormalLines = normals;
    }
}
# ---------- end tangentslopenormals_011 ----------
panel = Panel(tangentslopenormals_011.out)
geometry = Geometry(tangentslopenormals_011.TangentLines)
geometry_2 = Geometry(tangentslopenormals_011.NormalLines)
panel_2 = Panel(geometry)
param_viewer = ParamViewer(geometry)
