# Grasshopper definition CALCULUS_The_Derivatives_of_sin_cos_021.gh (Grasshopper 1.0.8)
# plug-ins: RhinoCodePluginGH

# ----
# Wickerson Studios Oscillation
trigger = Trigger(Interval=20, TimerInterval=20, Target=data_recorder)  # disabled
data_recorder = DataRecorder("1", DataLimit=10000, RecordData=True)
list_length = ListLength(List=data_recorder)
division = Division(A=list_length, B=Slider(488, range=0..1000))
sine = Sine(Value=division)
cosine = Cosine(Value=division)
number_slider = Slider(-20, range=-20..20)
multiplication = Multiplication(B=sine)
multiplication_2 = Multiplication(A=Slider(20, range=-20..20), B=cosine)

# ----
# Created at
# Wickerson Studios
# copyright 2024
# download all materials at
# www.wickersonstudios.com
# Visualizing Calculus Algorithm
# from
# gpt Image Prompt
number_slider_2 = Slider(100, range=0..100)
number_slider_3 = Slider(10, range=0..10)
number_slider_4 = Slider(10, range=0..10)
the_derivatives_of_sin_cos_021 = Script(width=number_slider_2, height=Slider(100, range=0..100), freq=multiplication, amp=multiplication_2)  # -> out, A, B, C; inputs width: Double, height: Double, freq: Double, amp: Double
# ---------- the_derivatives_of_sin_cos_021: C# ----------
// Grasshopper Script Instance
#region Usings
using System;
using System.Linq;
using System.Collections;
using System.Collections.Generic;
using System.Drawing;

using Rhino;
using Rhino.Geometry;

using Grasshopper;
using Grasshopper.Kernel;
using Grasshopper.Kernel.Data;
using Grasshopper.Kernel.Types;
#endregion

public class Script_Instance : GH_ScriptInstance
{
    #region Notes
    /* 
      Members:
        RhinoDoc RhinoDocument
        GH_Document GrasshopperDocument
        IGH_Component Component
        int Iteration

      Methods (Virtual & overridable):
        Print(string text)
        Print(string format, params object[] args)
        Reflect(object obj)
        Reflect(object obj, string method_name)
    */
    #endregion

    private void RunScript(
	double width,
	double height,
	double freq,
	double amp,
	ref object A,
	ref object B,
	ref object C)
    {
        // Calculate the number of divisions based on the frequency and amplitude
        int uDivisions = (int)(width * freq);
        int vDivisions = (int)(height * freq);

        List<Surface> surfaces = new List<Surface>();

        // Special angles for sine and cosine derivatives
        double[] angles = new double[] { freq * Math.PI / 4, freq * Math.PI / 3, freq * Math.PI / 6 };

        foreach (double angle in angles)
        {
            List<Point3d> points = new List<Point3d>();

            for (int i = 0; i <= uDivisions; i++)
            {
                for (int j = 0; j <= vDivisions; j++)
                {
                    double u = width * i / uDivisions;
                    double v = height * j / vDivisions;
                    double z = amp * Math.Cos(u * angle) * Math.Cos(v * angle); // Derivative of sine with respect to u
                    points.Add(new Point3d(u, v, z));
                }
            }

            // Create a surface from points
            NurbsSurface surface = NurbsSurface.CreateFromPoints(points, uDivisions + 1, vDivisions + 1, 3, 3);
            surfaces.Add(surface);
        }

        // Output the surfaces separately
        A = surfaces[0];
        B = surfaces[1];
        C = surfaces[2];
    }
}
# ---------- end the_derivatives_of_sin_cos_021 ----------
geometry = Geometry(the_derivatives_of_sin_cos_021.A)
geometry_2 = Geometry(the_derivatives_of_sin_cos_021.B)
geometry_3 = Geometry(the_derivatives_of_sin_cos_021.C)
panel = Panel(the_derivatives_of_sin_cos_021.out)
param_viewer = ParamViewer(geometry)
custom_preview = CustomPreview(Geometry=geometry_2, Material=ColourSwatch(SwatchColor=RGBA(255, 0, 255, 107)))
panel_2 = Panel([geometry, geometry_2, geometry_3])
custom_preview_2 = CustomPreview(Geometry=geometry, Material=ColourSwatch(SwatchColor=RGBA(0, 255, 255, 81)))
custom_preview_3 = CustomPreview(Geometry=geometry_3, Material=ColourSwatch(SwatchColor=RGBA(0, 0, 255, 119)))
