# Grasshopper definition CALCULUS_VelocityAndAccelerations_016.gh (Grasshopper 1.0.8)
# plug-ins: RhinoCodePluginGH, Kangaroo2 Components

# Visualizing Calculus Algorithm
# from
# gpt Image Prompt
number_slider = Slider(2.5, range=-1..10)
number_slider_2 = Slider(4, range=0..10)
# Created at
# Wickerson Studios
# copyright 2024
# download all materials at
# www.wickersonstudios.com
implicit_differentiation_015 = Script(radius=number_slider, resolution=Slider(7, range=0..10))  # -> out, A; inputs radius: Double, resolution: Int32
# ---------- implicit_differentiation_015: C# ----------
using System;
using System.Collections;
using System.Collections.Generic;
using System.Drawing;

using Rhino;
using Rhino.Geometry;

using Grasshopper;
using Grasshopper.Kernel;
using Grasshopper.Kernel.Data;
using Grasshopper.Kernel.Types;

public class Script_Instance : GH_ScriptInstance
{
  private void RunScript(double radius, int resolution, ref object A)
  {
    // Validation of input radius
    if (radius <= 0)
    {
      A = null;
      Print("Radius must be greater than zero.");
      return;
    }

    // Variables for the computation
    double r = radius; // Radius of the circle
    int res = resolution; // Number of points to calculate

    // Prepare a list to hold the points for visualization
    List<Line> tangentLines = new List<Line>();

    // Calculating points and derivatives using implicit differentiation
    for (int i = 0; i <= res; i++)
    {
      double angle = 2 * Math.PI * i / res; // Current angle
      double x = r * Math.Cos(angle); // x-coordinate on the circle
      double y = r * Math.Sin(angle); // y-coordinate on the circle

      // Implicit differentiation of x^2 + y^2 = r^2
      // dy/dx = -x/y (by implicit differentiation)
      if (Math.Abs(y) > 1e-6) // Avoid division by zero
      {
        double slope = -x / y;
        Vector3d direction = new Vector3d(1, slope, 0); // Tangent direction at the point
        direction.Unitize(); // Normalize the direction
        direction *= r / 5; // Scale the direction for visualization purposes

        // Create a tangent line at this point
        Point3d start = new Point3d(x, y, 0) - direction;
        Point3d end = new Point3d(x, y, 0) + direction;
        Line tangentLine = new Line(start, end);

        // Add to list
        tangentLines.Add(tangentLine);
      }
    }

    // Output the collection of tangent lines
    A = tangentLines;
  }

  // <Custom additional code> 

  public override void BeforeRunScript()
  {
    // Optional: Code to execute before the main script runs
  }

  // <Custom additional code end>
}
# ---------- end implicit_differentiation_015 ----------
implicit_differentiation_015_2 = Script(
    a=Slider(10, range=-1..10),
    b=Slider(2.5, range=-1..10),
    resolution=Slider(8, range=0..10),
    lineLength=Slider(3.34, range=0..10))  # -> out, A; inputs a: Double, b: Double, resolution: Int32, lineLength: Double
# ---------- implicit_differentiation_015_2: C# ----------
using System;
using System.Collections.Generic;
using System.Drawing;

using Rhino;
using Rhino.Geometry;

using Grasshopper;
using Grasshopper.Kernel;
using Grasshopper.Kernel.Types;

public class Script_Instance : GH_ScriptInstance
{
  private void RunScript(
	double a,
	double b,
	int resolution,
	double lineLength,
	ref object A)
  {
    // Validation of input parameters
    if (a <= 0 || b <= 0)
    {
      A = null;
      Print("Both semi-major axis 'a' and semi-minor axis 'b' must be greater than zero.");
      return;
    }

    // Prepare a list to hold the tangent lines for visualization
    List<Line> tangentLines = new List<Line>();

    // Calculating points and derivatives using implicit differentiation for an ellipse
    for (int i = 0; i < resolution; i++)
    {
      double angle = 2 * Math.PI * i / resolution; // Current angle
      double x = a * Math.Cos(angle); // x-coordinate on the ellipse
      double y = b * Math.Sin(angle); // y-coordinate on the ellipse

      // Implicit differentiation of (x^2/a^2) + (y^2/b^2) = 1
      // dy/dx = -(b^2/a^2) * (x/y)
      double slope = 0;
      if (Math.Abs(y) > 1e-6) // Avoid division by zero
      {
        slope = -(b * b) / (a * a) * (x / y);
      }

      Vector3d direction = new Vector3d(1, slope, 0); // Tangent direction at the point
      direction.Unitize(); // Normalize the direction
      direction *= lineLength; // Scale the direction based on the input parameter

      // Create a tangent line at this point
      Point3d start = new Point3d(x, y, 0) - direction;
      Point3d end = new Point3d(x, y, 0) + direction;
      Line tangentLine = new Line(start, end);

      // Add to list
      tangentLines.Add(tangentLine);
    }

    // Output the collection of tangent lines
    A = tangentLines;
  }

  // <Custom additional code> 

  public override void BeforeRunScript()
  {
    // Optional: Code to execute before the main script runs
  }

  // <Custom additional code end>
}
# ---------- end implicit_differentiation_015_2 ----------
implicit_differentiation_015_3 = Script(
    a=Slider(9.22, range=-1..10),
    b=Slider(7.36, range=-1..10),
    c=Slider(4.77, range=-1..10),
    uCount=number_slider_2,
    vCount=number_slider_2,
    planeSize=Slider(5.19, range=0..10))  # -> out, A; inputs a: Double, b: Double, c: Double, uCount: Int32, vCount: Int32, planeSize: Double
# ---------- implicit_differentiation_015_3: C# ----------
using System;
using System.Collections.Generic;
using System.Drawing;

using Rhino;
using Rhino.Geometry;

using Grasshopper;
using Grasshopper.Kernel;
using Grasshopper.Kernel.Types;

public class Script_Instance : GH_ScriptInstance
{
  private void RunScript(
	double a,
	double b,
	double c,
	int uCount,
	int vCount,
	double planeSize,
	ref object A)
  {
    // Validate the input parameters for axis lengths and plane size
    if (a <= 0 || b <= 0 || c <= 0 || planeSize <= 0)
    {
      A = null;
      Print("All semi-axes (a, b, c) and plane size must be greater than zero.");
      return;
    }

    // Prepare a list to hold the plane geometries for visualization
    List<Circle> tangentPlanes = new List<Circle>();

    // Generating planes using parametric equations of an ellipsoid
    for (int i = 0; i <= uCount; i++)
    {
      for (int j = 0; j <= vCount; j++)
      {
        double u = 2 * Math.PI * i / uCount; // Angle around the z-axis
        double v = Math.PI * j / vCount; // Angle from the pole

        // Parametric equations of the ellipsoid
        double x = a * Math.Cos(u) * Math.Sin(v);
        double y = b * Math.Sin(u) * Math.Sin(v);
        double z = c * Math.Cos(v);

        // Normal vector derived by implicit differentiation
        Vector3d normal = new Vector3d(2 * x / (a * a), 2 * y / (b * b), 2 * z / (c * c));
        normal.Unitize(); // Normalize the normal vector

        // Position and orientation of the tangent plane
        Point3d center = new Point3d(x, y, z);
        Plane tangentPlane = new Plane(center, normal);

        // Create a circular section to represent the tangent plane
        Circle circle = new Circle(tangentPlane, planeSize);
        tangentPlanes.Add(circle);
      }
    }

    // Output the collection of tangent planes represented by circles
    A = tangentPlanes;
  }

  // <Custom additional code> 

  public override void BeforeRunScript()
  {
    // Optional: Code to execute before the main script runs
  }

  // <Custom additional code end>
}
# ---------- end implicit_differentiation_015_3 ----------
geometry = Geometry(implicit_differentiation_015.A)
panel = Panel(implicit_differentiation_015.out)
geometry_2 = Geometry(implicit_differentiation_015_2.A)
geometry_3 = Geometry(implicit_differentiation_015_3.A)
panel_2 = Panel(implicit_differentiation_015_2.out)
panel_3 = Panel(implicit_differentiation_015_3.out)
panel_4 = Panel(geometry)
param_viewer = ParamViewer(geometry)
panel_5 = Panel(geometry_2)
param_viewer_2 = ParamViewer(geometry_2)
panel_6 = Panel(geometry_3)
param_viewer_3 = ParamViewer(geometry_3)
multipipe = MultiPipe(Curves=geometry_3, NodeSize=0.5, EndOffset=1, StrutSize=1, Segment=0, KinkAngle=0.6, CubeFit=0, Caps=0)
