# Grasshopper definition CALCULUS_continuity_010.gh (Grasshopper 1.0.8)
# plug-ins: RhinoCodePluginGH

# Created at
# Wickerson Studios
# copyright 2024
# download all materials at
# www.wickersonstudios.com
# Visualizing Calculus Algorithm
# from
# gpt Image Prompt
number_slider = Slider(-10, range=-10..10)
continuity_010b = Script(
    minX=number_slider,
    maxX=Slider(10, range=-10..10),
    minY=Slider(-10, range=-10..10),
    maxY=Slider(10, range=-10..10),
    resolution=Slider(77, range=1..100))  # -> out, A; inputs minX: Double, maxX: Double, minY: Double, maxY: Double, resolution: Int32
# ---------- continuity_010b: C# ----------
// Grasshopper Script Instance
#region Usings
using System;
using System.Linq;
using System.Collections;
using System.Collections.Generic;
using System.Drawing;

using Rhino;
using Rhino.Geometry;

using Grasshopper;
using Grasshopper.Kernel;
using Grasshopper.Kernel.Data;
using Grasshopper.Kernel.Types;
#endregion

using System;
using System.Collections;
using System.Collections.Generic;
using System.Drawing;

using Rhino;
using Rhino.Geometry;

using Grasshopper;
using Grasshopper.Kernel;
using Grasshopper.Kernel.Data;
using Grasshopper.Kernel.Types;

public class Script_Instance : GH_ScriptInstance
{
  /* 
    Members:
      RhinoDoc RhinoDocument
      GH_Document GrasshopperDocument
      IGH_Component Component
      int Iteration

    Methods (Virtual & overridable):
      Print(string text)
      Print(string format, params object[] args)
      Reflect(object obj)
      Reflect(object obj, string method_name)
  */
  
  private void RunScript(
	double minX,
	double maxX,
	double minY,
	double maxY,
	int resolution,
	ref object A)
  {
    Mesh mesh = new Mesh();

    double dx = (maxX - minX) / resolution;
    double dy = (maxY - minY) / resolution;

    // Generate mesh vertices
    for (double x = minX; x <= maxX; x += dx)
    {
      for (double y = minY; y <= maxY; y += dy)
      {
        double z = Math.Sin(x * x + y * y); // z = sin(x^2 + y^2)
        mesh.Vertices.Add(new Point3d(x, y, z));
      }
    }

    // Create faces for the mesh
    int cols = resolution + 1; // Number of columns in the mesh grid
    for (int i = 0; i < resolution; i++)
    {
      for (int j = 0; j < resolution; j++)
      {
        int lowerLeft = i * cols + j;
        int lowerRight = lowerLeft + 1;
        int upperLeft = lowerLeft + cols;
        int upperRight = upperLeft + 1;

        mesh.Faces.AddFace(lowerLeft, lowerRight, upperRight, upperLeft);
      }
    }

    mesh.Normals.ComputeNormals();
    mesh.Compact();

    A = mesh;
  }
  
  // <Custom additional code>
}
# ---------- end continuity_010b ----------
geometry = Geometry(continuity_010b.A)
panel = Panel(geometry)
param_viewer = ParamViewer(geometry)
panel_2 = Panel(continuity_010b.out)
