# Grasshopper definition CALCULUS_coordinateGraphs_003.gh (Grasshopper 1.0.8)
# plug-ins: RhinoCodePluginGH

number_slider = Slider(10, range=-10..10)
number_slider_2 = Slider(-10, range=-10..10)
# Created at
# Wickerson Studios
# copyright 2024
# download all materials at
# www.wickersonstudios.com
# Visualizing Calculus Algorithm
# from
# gpt Image Prompt
number_slider_3 = Slider(-10, range=-10..10)
coordinategraph_003 = Script(
    xStart=number_slider_3,
    xEnd=Slider(10, range=-10..10),
    numPoints=Slider(100, range=1..100),
    scaleFactor=Slider(3, range=0.1..3))  # -> out, A, B, C, D, E; inputs xStart: Double, xEnd: Double, numPoints: Int32, scaleFactor: Double
# ---------- coordinategraph_003: C# ----------
using System;
using System.Collections.Generic;
using System.Drawing;

using Rhino;
using Rhino.Geometry;

using Grasshopper;
using Grasshopper.Kernel;
using Grasshopper.Kernel.Data;
using Grasshopper.Kernel.Types;

public class Script_Instance : GH_ScriptInstance
{
    private void RunScript(
	double xStart,
	double xEnd,
	int numPoints,
	double scaleFactor,
	ref object A,
	ref object B,
	ref object C,
	ref object D,
	ref object E)
    {
        // Define lists to hold points for the curves
        List<Point3d> curvePoints = new List<Point3d>();
        List<Point3d> derivativePoints = new List<Point3d>();
        List<Point3d> absCurvePoints = new List<Point3d>();
        List<Point3d> absDerivativePoints = new List<Point3d>();
        List<Point3d> limitPoints = new List<Point3d>();

        // Calculate step size
        double xStep = (xEnd - xStart) / (numPoints - 1);

        for (int i = 0; i < numPoints; i++)
        {
            double x = xStart + i * xStep;
            double y = scaleFactor * Math.Sin(x);
            double dy = scaleFactor * Math.Cos(x);
            double absY = scaleFactor * Math.Abs(x);
            double absDy = (x > 0) ? scaleFactor : (x < 0) ? -scaleFactor : 0; // Handling the derivative of absolute value

            curvePoints.Add(new Point3d(x, y, 0));
            derivativePoints.Add(new Point3d(x, 0, dy));
            absCurvePoints.Add(new Point3d(x, absY, 0));

            if (x != 0)
            {
                absDerivativePoints.Add(new Point3d(x, 0, absDy));
            }

            if (Math.Abs(x) < 0.1)
            {
                limitPoints.Add(new Point3d(x, y, dy + 0.5));
                limitPoints.Add(new Point3d(x, y, dy - 0.5));
            }
        }

        // Create curves from the points
        Curve functionCurve = new PolylineCurve(curvePoints);
        Curve derivativeCurve = new PolylineCurve(derivativePoints);
        Curve absFunctionCurve = new PolylineCurve(absCurvePoints);
        Curve absDerivativeCurve = new PolylineCurve(absDerivativePoints);

        // Set outputs
        A = functionCurve;
        B = derivativeCurve;
        C = absFunctionCurve;
        D = absDerivativeCurve;
        E = limitPoints;
    }

    // <Custom additional code> 
}
# ---------- end coordinategraph_003 ----------
geometry = Geometry(coordinategraph_003.A)
geometry_2 = Geometry(coordinategraph_003.B)
geometry_3 = Geometry(coordinategraph_003.C)
geometry_4 = Geometry(coordinategraph_003.D)
geometry_5 = Geometry(coordinategraph_003.E)
panel = Panel(coordinategraph_003.out)
panel_2 = Panel([geometry, geometry_2, geometry_3, geometry_4, geometry_5])
entwine = Entwine(
    Branch00=geometry,
    Branch01=geometry_2,
    Branch02=geometry_3,
    Branch03=geometry_4,
    Branch04=geometry_5,
    FlattenInputs=True)
param_viewer = ParamViewer(entwine)
