# Grasshopper definition CALCULUS_infiniteLimits_009.gh (Grasshopper 1.0.8)
# plug-ins: RhinoCodePluginGH

# Created at
# Wickerson Studios
# copyright 2024
# download all materials at
# www.wickersonstudios.com
# Visualizing Calculus Algorithm
# from
# gpt Image Prompt
number_slider = Slider(1.92, range=0.1..10)
infinitelimits_009b = Script(range=number_slider, divisions=Slider(35, range=0..100))  # -> out, A; inputs range: Double, divisions: Int32
# ---------- infinitelimits_009b: C# ----------
using System;
using System.Collections.Generic;
using Rhino.Geometry;

public class Script_Instance : GH_ScriptInstance
{
  private void RunScript(
	double range,
	int divisions,
	object x,
	object y,
	ref object A)
  {
    // Parse input parameters safely
    //double range = 2.0; // Default range
    //int divisions = 100; // Default divisions
    double threshold = 0.01; // Default threshold

    // Try to get values from x and y, assuming x is a list of parameters
    if (x is List<object> inputs && inputs.Count >= 3)
    {
      if (!double.TryParse(inputs[0].ToString(), out range))
        range = 2.0; // fallback to default if parsing fails
      if (!int.TryParse(inputs[1].ToString(), out divisions))
        divisions = 100; // fallback to default if parsing fails
      if (!double.TryParse(inputs[2].ToString(), out threshold))
        threshold = 0.01; // fallback to default if parsing fails
    }

    List<Point3d> points = new List<Point3d>(); // List to store the points
    Mesh mesh = new Mesh(); // Initialize a new mesh

    double step = (2 * range) / divisions; // Step size
    for (int i = 0; i <= divisions; i++)
    {
      double ix = -range + i * step;
      for (int j = 0; j <= divisions; j++)
      {
        double iy = -range + j * step;
        double dist = ix * ix + iy * iy;
        if (dist < threshold * threshold) continue; // Skip points too close to the singularity

        double z = 1 / dist; // Evaluate the function
        Point3d newPoint = new Point3d(ix, iy, z);
        points.Add(newPoint); // Add the point to the list
        mesh.Vertices.Add(newPoint); // Add the vertex to the mesh
      }
    }

    // Add faces to the mesh
    for (int i = 0; i < divisions; i++)
    {
      for (int j = 0; j < divisions; j++)
      {
        int lowerLeft = i * (divisions + 1) + j;
        int lowerRight = lowerLeft + 1;
        int upperLeft = lowerLeft + divisions + 1;
        int upperRight = upperLeft + 1;

        mesh.Faces.AddFace(lowerLeft, lowerRight, upperRight, upperLeft);
      }
    }

    mesh.Normals.ComputeNormals();
    mesh.Compact();

    A = mesh; // Output the mesh
  }

  // Override additional members here
}
# ---------- end infinitelimits_009b ----------
geometry = Geometry(infinitelimits_009b.A)
panel = Panel(geometry)
param_viewer = ParamViewer(geometry)
panel_2 = Panel(infinitelimits_009b.out)
