# Grasshopper definition CALCULUS_invertingNonOneToOneFunctions_006.gh (Grasshopper 1.0.8)
# plug-ins: RhinoCodePluginGH

# Created at
# Wickerson Studios
# copyright 2024
# download all materials at
# www.wickersonstudios.com
# Visualizing Calculus Algorithm
# from
# gpt Image Prompt
number_slider = Slider(-10, range=-10..10)
invertingonttoonefunction = Script(minX=number_slider, maxX=Slider(10, range=-10..10), step=Slider(1, range=0..1))  # -> out, A; inputs minX: Double, maxX: Double, step: Double
# ---------- invertingonttoonefunction: C# ----------
using System;
using System.Collections.Generic;
using Rhino.Geometry;  // Include Rhino.Geometry for Rhino specific geometry types

public class Script_Instance : GH_ScriptInstance
{
    private void RunScript(double minX, double maxX, double step, ref object A)
    {
        // Validate inputs
        if (step <= 0)
        {
            A = "Error: Step size must be positive.";
            return;
        }
        if (minX > maxX)
        {
            A = "Error: minX must be less than maxX.";
            return;
        }

        // Create lists to store points
        List<Point3d> functionPoints = new List<Point3d>();
        List<Point3d> inversePoints = new List<Point3d>();

        try
        {
            // Generate points for the function y = x^2 and its mathematical inverse y = sqrt(x) within specified range
            for (double x = minX; x <= maxX; x += step)
            {
                double y = x * x;  // y = x^2
                Point3d ptFunc = new Point3d(x, y, 0);  // Point on the function
                if (y >= 0)  // Check domain for sqrt
                {
                    Point3d ptInv = new Point3d(y, Math.Sqrt(y), 0);  // Point on the inverse function
                    inversePoints.Add(ptInv);
                }
                functionPoints.Add(ptFunc);
            }

            // Create curves from the points
            Curve funcCurve = Curve.CreateInterpolatedCurve(functionPoints, 3);
            Curve invCurve = Curve.CreateInterpolatedCurve(inversePoints, 3);

            // Set output
            A = new List<Curve> { funcCurve, invCurve };
        }
        catch (Exception ex)
        {
            A = "Error: " + ex.Message;
        }
    }

    // <Custom additional code>
}
# ---------- end invertingonttoonefunction ----------
panel = Panel(invertingonttoonefunction.out)
geometry = Geometry(invertingonttoonefunction.A)
panel_2 = Panel(geometry)
entwine = Entwine(Branch00=geometry, FlattenInputs=True)
param_viewer = ParamViewer(entwine)
