# Grasshopper definition CALCULUS_limits_007.gh (Grasshopper 1.0.8)
# plug-ins: RhinoCodePluginGH

# Created at
# Wickerson Studios
# copyright 2024
# download all materials at
# www.wickersonstudios.com
# Visualizing Calculus Algorithm
# from
# gpt Image Prompt
number_slider = Slider(7, range=0..10)
limits_007 = Script(
    x_count=number_slider,
    y_count=Slider(7, range=0..10),
    step=Slider(4.24, range=0..10),
    a=Slider(3, range=-3..3),
    b=Slider(2.45, range=-3..3),
    c=Slider(3, range=-3..3))  # -> out, A, B, C, D; inputs x_count: Int32, y_count: Int32, step: Double, a: Double, b: Double, c: Double
# ---------- limits_007: C# ----------
using System;
using System.Collections.Generic;
using Rhino.Geometry;

public class Script_Instance : GH_ScriptInstance
{
    private void RunScript(
	int x_count,
	int y_count,
	double step,
	double a,
	double b,
	double c,
	ref object A,
	ref object B,
	ref object C,
	ref object D)
    {
        Mesh mesh = CreateMesh(x_count, y_count, step, a, b, c);
        List<Point3d> xLimitPoints, yLimitPoints, diagLimitPoints;
        LimitPoints(x_count, step, a, b, c, out xLimitPoints, out yLimitPoints, out diagLimitPoints);

        A = mesh;
        B = xLimitPoints;
        C = yLimitPoints;
        D = diagLimitPoints;
    }

    public Mesh CreateMesh(int x_count, int y_count, double step, double a, double b, double c)
    {
        Mesh mesh = new Mesh();

        for (int i = 0; i < x_count; i++)
        {
            for (int j = 0; j < y_count; j++)
            {
                double x = i * step;
                double y = j * step;
                double z = a * Math.Cos(b * (x * x + y * y)) + c * Math.Sin(x * y) + 1.0 / (x * x + y * y + 1);
                mesh.Vertices.Add(x, y, z);
            }
        }

        for (int i = 0; i < x_count - 1; i++)
        {
            for (int j = 0; j < y_count - 1; j++)
            {
                mesh.Faces.AddFace(i * y_count + j, (i + 1) * y_count + j, (i + 1) * y_count + (j + 1), i * y_count + (j + 1));
            }
        }

        return mesh;
    }

    public void LimitPoints(int x_count, double step, double a, double b, double c, out List<Point3d> xLimitPoints, out List<Point3d> yLimitPoints, out List<Point3d> diagLimitPoints)
    {
        xLimitPoints = new List<Point3d>();
        yLimitPoints = new List<Point3d>();
        diagLimitPoints = new List<Point3d>();

        for (int i = 1; i < x_count; i++)
        {
            double x = i * step;
            double y = i * step;

            double xz = a * Math.Cos(b * x * x) + c * 1.0 / (x * x + 1);
            xLimitPoints.Add(new Point3d(x, 0, xz));

            double yz = a * Math.Cos(b * y * y) + c * 1.0 / (y * y + 1);
            yLimitPoints.Add(new Point3d(0, y, yz));

            double diagz = a * Math.Cos(b * (x * x + y * y)) + c * Math.Sin(x * y) + 1.0 / (x * x + y * y + 1);
            diagLimitPoints.Add(new Point3d(x, y, diagz));
        }
    }
}
# ---------- end limits_007 ----------
mesh = Mesh(limits_007.A)
panel = Panel(limits_007.out)
entwine = Entwine(Branch00=mesh, Branch01=limits_007.B, Branch02=limits_007.C, Branch03=limits_007.D, FlattenInputs=True)
panel_2 = Panel(entwine)
param_viewer = ParamViewer(entwine)
