# Grasshopper definition CALCULUS_oddEvenFunctions_005.gh (Grasshopper 1.0.8)
# plug-ins: RhinoCodePluginGH

# Created at
# Wickerson Studios
# copyright 2024
# download all materials at
# www.wickersonstudios.com
# Visualizing Calculus Algorithm
# from
# gpt Image Prompt
number_slider = Slider(-10, range=-10..10)
oddevenunctions_005b = Script(
    xStart=number_slider,
    xEnd=Slider(10, range=-10..10),
    zStart=Slider(-10, range=-10..10),
    zEnd=Slider(10, range=-10..10),
    xStep=Slider(0.5, range=0..1),
    zStep=Slider(0.5, range=0..1))  # -> out, EvenOutput, OddOutput; inputs xStart: Double, xEnd: Double, zStart: Double, zEnd: Double, xStep: Double, zStep: Double
# ---------- oddevenunctions_005b: C# ----------
using System;
using System.Numerics;
using Rhino.Geometry;

public class Script_Instance : GH_ScriptInstance
{
    private void RunScript(
	double xStart,
	double xEnd,
	double zStart,
	double zEnd,
	double xStep,
	double zStep,
	ref object EvenOutput,
	ref object OddOutput)
    {
        // Parameters for the model
        // double xStart = -10.0;
        // double xEnd = 10.0;
        // double zStart = -10.0;
        // double zEnd = 10.0;
        // double xStep = 0.5;
        // double zStep = 0.5;

        // Initialize meshes
        Mesh evenMesh = new Mesh();
        Mesh oddMesh = new Mesh();

        // Create geometry for even and odd functions
        for (double x = xStart; x <= xEnd; x += xStep)
        {
            for (double z = zStart; z <= zEnd; z += zStep)
            {
                Complex evenResult = EvenComplexFunction(x, z);
                Complex oddResult = OddComplexFunction(x, z);

                // Using only the real parts for demonstration
                Point3d evenPoint = new Point3d(x, evenResult.Real, z);
                Point3d oddPoint = new Point3d(x, oddResult.Real, z);

                evenMesh.Vertices.Add(evenPoint);
                oddMesh.Vertices.Add(oddPoint);
            }
        }

        // Create mesh faces for even and odd functions
        int rowCount = (int)((xEnd - xStart) / xStep) + 1;
        int columnCount = (int)((zEnd - zStart) / zStep) + 1;
        AddMeshFaces(evenMesh, rowCount, columnCount);
        AddMeshFaces(oddMesh, rowCount, columnCount);

        // Output to Grasshopper
        EvenOutput = evenMesh;
        OddOutput = oddMesh;
    }

    // Definitions of even and odd complex functions
    private Complex EvenComplexFunction(double x, double z)
    {
        return Complex.Cos(new Complex(x, z));
    }

    private Complex OddComplexFunction(double x, double z)
    {
        return Complex.Sin(new Complex(x, z));
    }

    // Method to create mesh faces based on vertex index
    private void AddMeshFaces(Mesh mesh, int rowCount, int columnCount)
    {
        for (int i = 0; i < rowCount - 1; i++)
        {
            for (int j = 0; j < columnCount - 1; j++)
            {
                int a = i + j * rowCount;
                int b = (i + 1) + j * rowCount;
                int c = (i + 1) + (j + 1) * rowCount;
                int d = i + (j + 1) * rowCount;
                mesh.Faces.AddFace(a, b, c, d);
            }
        }
    }
}
# ---------- end oddevenunctions_005b ----------
geometry = Geometry(oddevenunctions_005b.OddOutput)
geometry_2 = Geometry(oddevenunctions_005b.EvenOutput)
panel = Panel(oddevenunctions_005b.out)
panel_2 = Panel([geometry_2, geometry])
entwine = Entwine(Branch00=geometry_2, Branch01=geometry, FlattenInputs=True)
param_viewer = ParamViewer(entwine)
