# Grasshopper definition CALCULUS_oneSidedLimits_008.gh (Grasshopper 1.0.8)
# plug-ins: RhinoCodePluginGH

# Created at
# Wickerson Studios
# copyright 2024
# download all materials at
# www.wickersonstudios.com
# Visualizing Calculus Algorithm
# from
# gpt Image Prompt
panel = Panel("0")
onesidedlimits_008 = Script(limitPointX=panel, start=Slider(1, range=-1..1), end=Slider(0.1, range=0.1..1))  # -> out, a; inputs limitPointX: Double, start: Double, end: Double
# ---------- onesidedlimits_008: C# ----------
//Grasshopper Script Instance
//#! csharp
using System;
using System.Collections.Generic;
using System.Drawing;

using Rhino;
using Rhino.Geometry;

using Grasshopper;
using Grasshopper.Kernel;
using Grasshopper.Kernel.Data;
using Grasshopper.Kernel.Types;

public class Script_Instance : GH_ScriptInstance
{
  private void RunScript(
	double limitPointX,
	double start,
	double end,
	ref object a)
  {
    // Define the function f(x) = 1/x and visualize the approach to x = 0 from one side
    //double limitPointX = 0;  // x-value where we examine the limit
    //double start = -1;       // start x-value for curve drawing
    //double end = -0.1;       // end x-value close to the limit point from the left
    int pointsCount = 100;   // number of points to generate

    List<Point3d> points = new List<Point3d>();
    double step = (end - start) / pointsCount;

    for(int i = 0; i <= pointsCount; i++)
    {
      double currentX = start + step * i;
      double currentY = 1 / currentX;
      points.Add(new Point3d(currentX, currentY, 0)); // z-coordinate is 0 for 2D visualization
    }

    // Create a curve from the generated points
    Curve curve = Curve.CreateInterpolatedCurve(points, 3);
    if (curve != null)
    {
      a = curve;
    }
    else
    {
      a = null;
      Print("Failed to create curve.");
    }
  }

  // Additional helper methods can be added here
}
# ---------- end onesidedlimits_008 ----------
geometry = Geometry(onesidedlimits_008.a)
panel_2 = Panel(onesidedlimits_008.out)
param_viewer = ParamViewer(geometry)
panel_3 = Panel(geometry)
