# Grasshopper definition CALCULUS_oneSidedLimits_008a.gh (Grasshopper 1.0.8)
# plug-ins: RhinoCodePluginGH

# Created at
# Wickerson Studios
# copyright 2024
# download all materials at
# www.wickersonstudios.com
# Visualizing Calculus Algorithm
# from
# gpt Image Prompt
number_slider = Slider(0.07, range=0..1)
onesidedlimits_008 = Script(x=number_slider, y=Slider(4.07, range=0..10))  # -> out, CurveOutput, PointsOutput
# ---------- onesidedlimits_008: C# ----------
// Grasshopper Script Instance
#region Usings
using System;
using System.Collections.Generic;
using System.Drawing;

using Rhino;
using Rhino.Geometry;

using Grasshopper;
using Grasshopper.Kernel;
using Grasshopper.Kernel.Data;
using Grasshopper.Kernel.Types;
#endregion

public class Script_Instance : GH_ScriptInstance
{
    #region Notes
    /*
      Members:
        RhinoDoc RhinoDocument
        GH_Document GrasshopperDocument
        IGH_Component Component
        int Iteration

      Methods (Virtual & overridable):
        Print(string text)
        Print(string format, params object[] args)
        Reflect(object obj)
        Reflect(object obj, string method_name)
    */
    #endregion

    private void RunScript(
	object x,
	object y,
	ref object CurveOutput,
	ref object PointsOutput)
    {
        // Ensure that x and y are not null and are valid doubles
        if (x == null || y == null)
        {
            Component.AddRuntimeMessage(GH_RuntimeMessageLevel.Error, "Input x or y is null");
            CurveOutput = null;
            PointsOutput = null;
            return;
        }

        if (!double.TryParse(x.ToString(), out double startX) ||
            !double.TryParse(y.ToString(), out double endX))
        {
            Component.AddRuntimeMessage(GH_RuntimeMessageLevel.Error, "Input must be two valid doubles");
            CurveOutput = null;
            PointsOutput = null;
            return;
        }

        if (endX <= startX)
        {
            Component.AddRuntimeMessage(GH_RuntimeMessageLevel.Error, "End X must be greater than Start X");
            CurveOutput = null;
            PointsOutput = null;
            return;
        }

        // Generate points on the curve f(x) = 1/x
        List<Point3d> points = new List<Point3d>();
        double step = (endX - startX) / 100; // Let's assume we want 100 points for smoothness
        for (double xi = startX; xi <= endX; xi += step)
        {
            if (xi != 0) // Avoid division by zero
            {
                double yi = 1 / xi;
                points.Add(new Point3d(xi, yi, 0));
            }
        }

        // Output the points
        PointsOutput = points.Count > 0 ? points : null;

        // Create a curve from the points
        if (points.Count > 0)
        {
            Curve curve = Curve.CreateInterpolatedCurve(points, 3);
            CurveOutput = curve;
        }
        else
        {
            Component.AddRuntimeMessage(GH_RuntimeMessageLevel.Warning, "No valid points were generated to create a curve");
            CurveOutput = null;
        }
    }
}
# ---------- end onesidedlimits_008 ----------
panel = Panel(onesidedlimits_008.out)
geometry = Geometry(onesidedlimits_008.CurveOutput)
geometry_2 = Geometry(onesidedlimits_008.PointsOutput)
panel_2 = Panel([geometry, geometry_2])
param_viewer = ParamViewer(geometry)
