# Grasshopper definition CALCULUS_tangentSlopeNormals_011.gh (Grasshopper 1.0.8)

# Created at
# Wickerson Studios
# copyright 2024
# download all materials at
# www.wickersonstudios.com
# Visualizing Calculus Algorithm
# from
# gpt Image Prompt
sphere = Sphere(Base=PlaneXY(0, 0, 0), Radius=1)
geometry = Geometry()
panel = Panel(geometry)
param_viewer = ParamViewer(geometry)
